# Grasshopper definition orbs.gh (Grasshopper 1.0.7)
# plug-ins: Bifocals

# ---- group: RH_IN:grow
number_slider = Slider(70, range=10..100)

# ---- group: RH_IN:seed
number_slider_2 = Slider(79, range=10..100)

# ----
unit_z = UnitZ(Factor=number_slider)
ellipse = Ellipse(Plane=PlaneXY(0, 0, 0), Radius1=Slider(10, range=3..20), Radius2=Slider(14, range=3..20))  # -> Ellipse, Focus1, Focus2
move = Move(Geometry=ellipse.Ellipse, Motion=unit_z)  # -> Geometry, Transform
rotate = Rotate(Geometry=ellipse.Ellipse, Angle="150", Plane=PlaneXY(0, 0, 0))  # -> Geometry, Transform
scale = Scale(Geometry=move.Geometry, Center=Point(0, 0, 0), Factor=0.5)  # -> Geometry, Transform
geometry = Geometry(move.Geometry)
geometry_2 = Geometry(rotate.Geometry)
geometry_3 = Geometry(scale.Geometry)
loft = Loft(
    Curves=[geometry_2, geometry_3, geometry],
    Options={Adjust=False, Closed=False, LoftEnds=0, LoftSimp=0, LoftType=0, Rebuild=10, Refit=0.01})
populate_geometry = PopulateGeometry(Geometry=loft, Count=number_slider, Seed=number_slider_2)
construct_point = ConstructPoint(XCoordinate=0, YCoordinate=0, ZCoordinate=0)
unit_z_2 = UnitZ(Factor=number_slider)
number_slider_3 = Slider(10, range=0..10)
line_sdl = LineSDL(Start=construct_point, Direction=unit_z_2, Length=number_slider)
point = Point(populate_geometry)
divide_length = DivideLength(Curve=line_sdl, Length=Slider(3, range=1..5))  # -> Points, Tangents, Parameters
closest_point = ClosestPoint(Point=divide_length.Points, Cloud=point)  # -> ClosestPoint, CPIndex, Distance
panel = Panel(closest_point.ClosestPoint)
line = Line(StartPoint=divide_length.Points, EndPoint=closest_point.ClosestPoint)
curve = Curve(line)
sphere = Sphere(Base=panel, Radius=Slider(4, range=1..10))
sphere_2 = Sphere(Base=point, Radius=Slider(2, range=1..10))
pipe = Pipe(Curve=curve, Radius=1, Caps=0)  # -> flatten(Pipe)

# ---- group: RH_OUT:pointlarge
mesh = Mesh(pipe)

# ----
mesh_2 = Mesh(sphere)

# ---- group: RH_OUT:pointsmall
mesh_3 = Mesh(sphere_2)
